# Grasshopper definition lightswitcher.gh (Grasshopper 1.0.8)
# plug-ins: RhinoCodePluginGH

toggle = BooleanToggle(False)
path = FilePath("C:\Users\JNash\Desktop\state.txt")
trigger = Trigger(Interval=500, TimerInterval=500, Target=c_script)
c_script = CSharpScript(x=path)  # -> out, a; inputs x: String
# ---------- c_script: C# ----------
// Grasshopper Script Instance
#region Usings
using System;
using System.Linq;
using System.Collections;
using System.Collections.Generic;
using System.Drawing;
using System.IO;
using System.Drawing;

using Rhino;
using Rhino.Geometry;

using Grasshopper;
using Grasshopper.Kernel;
using Grasshopper.Kernel.Data;
using Grasshopper.Kernel.Types;
#endregion

public class Script_Instance : GH_ScriptInstance
{
    #region Notes
    /* 
      Members:
        RhinoDoc RhinoDocument
        GH_Document GrasshopperDocument
        IGH_Component Component
        int Iteration

      Methods (Virtual & overridable):
        Print(string text)
        Print(string format, params object[] args)
        Reflect(object obj)
        Reflect(object obj, string method_name)
    */
    #endregion

    private void RunScript(string x, object y, ref object a)
    {
        string state = "";
Color toggle = Color.Black;

try
{
    if (File.Exists(x))
    {
        state = File.ReadAllText(x).Trim().ToLower();
        // curl -X POST http://localhost:5000/turn_on
        if (state == "on")
        {
            toggle = Color.LightYellow;
        }
        //curl -X POST http://localhost:5000/turn_off
        else if (state == "off")
        {
            toggle = Color.Black;
        }
    }
}
catch (Exception e)
{
    Console.WriteLine("Error reading file: " + e.Message);
}

a = toggle;
    }
}
# ---------- end c_script ----------
pt = Point(Point(710.0646831, 878.5510996, 0))
dots = DotDisplay(Point=pt, Colour=c_script.a, Size=1)
